# Grasshopper definition area_calculator_from_brep_universal_v2.gh (Grasshopper 0.9.76)
# plug-ins: Python Interpreter, Anemone, LunchBox

# ---- group: optional
# Create Loft from Curves
pipeline = GeometryPipeline(
    GroupByLayer=False,
    GroupByType=False,
    IncludeHidden=True,
    IncludeLocked=True,
    LayerFilter="massing layer",
    NameFilter="*",
    TypeFilter=1073741848)
geo = Geometry(pipeline)
sunion = SolidUnion(Breps=geo)

# ----
# Adjust
adjust_curve_resolution_lower_is_higher = Slider(674, range=0..1000)  # "Adjust Curve Resolution (lower is higher res)"
see_curve_resolution = BooleanToggle(False)

# ---- group: display settings
scrub_to_move_text_away_from_breps = Slider(1.1, range=1..3)
scrub_to_avoid_text_occlusion = Slider(185, range=0..1000)
text_size_scales_with_shape = Slider(134, range=0..1000)

# ---- group: all breps (if intersecting, must perform boolean union)
# Input
brep = Brep(sunion)

# ----
clean = CleanTree(RemoveNulls=True, RemoveInvalid=True, RemoveEmpty=False, Tree=brep)
clean_up_short_lines_mm = Slider(44, range=0..100)

# ----
# Results
preview_floor_no = Slider(4, range=1..30)
toggle_all_floors_preview = BooleanToggle(True)
press_to_hide_preview = Button()
bake_full_res_floors = Button()
bake_all_surfaces = Button()

# ---- group: 1. perform section
brep_2 = Brep(clean)
brep_input_shape_to_calculate_with_holes = Brep(brep_2)  # "Brep (Input Shape to Calculate, with holes untrimmed)"
smooth = SettingsQuality()
mesh = MeshBrep(Brep=brep_input_shape_to_calculate_with_holes, Settings=smooth)

# ---- group: 1. perform section / floor number and height
floor_height = Panel("8000")
how_many_floors = Panel("20")
series = Series(Start=0, Step=floor_height, Count=how_many_floors)
panel = Panel("20")
replace = ReplaceItems(List=series, Item=panel, Indices=0, Wrap=False)
grnd_floor_is_20mm_higher_to_avoid_missi = Panel(replace)  # "grnd floor is 20mm higher to avoid missing the cut"
Z = UnitZ(Factor=replace)

xy = XYPlane(Origin=Point(0, 0, 0))
move = Move(Geometry=xy, Motion=Z)  # -> simplify(graft(Geometry)), Transform

data = Data(move.Geometry)

# ---- group: 1. perform section (continued)
sec = MeshPlane(Mesh=mesh, Plane=data)
redpline = Reduce(Polyline=sec, Tolerance=adjust_curve_resolution_lower_is_higher)  # -> Polyline, Reduction

# ---- group: press play to run, double click reset to recalculate
# Run
dam = DataDam(DataA=redpline.Polyline, BufferDelay=20000000, BufferMode=2)
switch = PythonScript(x=flatten(dam))  # -> out, a; inputs x: list
# ---------- switch: Python ----------
import rhinoscriptsyntax as rs
import scriptcontext as sc

x = str(len(x))

def switch(trigger, init_state):
    print 'switch is', x
    if not sc.sticky.has_key(trigger):
        print 'initializing memory'
        sc.sticky[trigger] = init_state  # initialize state as false
        return init_state
    if sc.sticky.has_key(trigger):
        temp = sc.sticky[trigger]
        print 'current state', temp
    
    if temp == False:
        print 'switching from false to true'
        sc.sticky[trigger] = True
        return True
    if temp == True:
        print 'switching from true to false'
        sc.sticky[trigger] = False
        return False

if x:
    a = switch(x, False)
# ---------- end switch ----------

# ----
bake = ObjectBake(
    BakeToggle=bake_full_res_floors,
    GeometryObjects=flatten(sec),
    Layer="gh_floors_full_resolution",
    ObjectName="GH_Obj",
    ObjectColor=RGB(255, 255, 255),
    LayerColor=RGB(255, 255, 255))

cp = ControlPoints(Curve=redpline.Polyline)  # -> Points, Weights, Knots
cull = CullPattern(List=cp.Points, CullPattern=see_curve_resolution)
pline = PolyLine(Vertices=cull, Closed=False)
preview = CustomPreview(Geometry=[pline, cull], Shader=ColourSwatch(SwatchColor=RGB(207, 207, 207)))

pshift = ShiftPaths(Data=dam, Offset=-1)
data_2 = Data(data)

# ---- group: move ground floor back down by 20
data_3 = Data(data_2)
tstat = TreeStatistics(Tree=data_3)  # -> Paths, Length, Count
cull_i = CullIndex(List=tstat.Paths, Indices=0, Wrap=True)
item = ListItem(List=tstat.Paths, Index=0, Wrap=True)
branch = TreeBranch(Tree=data_3, Path=cull_i, MaintainPaths=True)
branch_2 = TreeBranch(Tree=data_3, Path=item, MaintainPaths=True)
Z_2 = UnitZ(Factor=expr("-x", panel))
move_2 = Move(Geometry=branch_2, Motion=Z_2)  # -> Geometry, Transform
data_4 = Data([move_2.Geometry, branch])

# ----
panel_2 = Panel(floor_height)
Z_3 = UnitZ(Factor=expr("-x", panel_2))

# ---- group: 2. close all curves
join = JoinCurves(Curves=pshift, Preserve=False)
cls = Closed(Curve=join)  # -> Closed, Periodic
lng = ListLength(List=cls.Closed)
ma = MassAddition(Input=cls.Closed)  # -> Result, PartialResults
equals = Equality(FirstNumber=lng, SecondNumber=ma.Result)  # -> Equality, Inequality

# ---- group: 2. close all curves / open curve sets.
cull_2 = CullPattern(List=join, CullPattern=invert(equals.Equality))  # -> simplify(List)

# ---- group: 2. close all curves / closed curve sets. no extra processing needed.
cull_3 = CullPattern(List=join, CullPattern=equals.Equality)  # -> simplify(List)

# ---- group: 2. close all curves (continued)
c_script = CSharpScript(curves=cull_2, tolerance=Slider(1000, range=0..1000))  # -> out, simplify(A); inputs curves: list of Curve, tolerance: Double
# ---------- c_script: C# ----------
    A = Curve.JoinCurves(curves, tolerance);
# ---------- end c_script ----------
geo_2 = Geometry(c_script.A)
cls_2 = Closed(Curve=geo_2)  # -> Closed, Periodic
are_they_all_closed = Panel(cls_2.Closed)
crv = Curve(c_script.A)
crv_2 = Curve(cull_3)
crv_3 = Curve([crv_2, crv])

# ----
crv_4 = Curve(crv_3)

# ---- group: move ground floor back down by 20
crv_5 = Curve(crv_4)
tstat_2 = TreeStatistics(Tree=crv_5)  # -> Paths, Length, Count
cull_i_2 = CullIndex(List=tstat_2.Paths, Indices=0, Wrap=True)
item_2 = ListItem(List=tstat_2.Paths, Index=0, Wrap=True)
branch_3 = TreeBranch(Tree=crv_5, Path=cull_i_2, MaintainPaths=True)
branch_4 = TreeBranch(Tree=crv_5, Path=item_2, MaintainPaths=True)
Z_4 = UnitZ(Factor=expr("-x", panel))
move_3 = Move(Geometry=branch_4, Motion=Z_4)  # -> Geometry, Transform
crv_6 = Curve([branch_3, move_3.Geometry])

# ----
boundary = BoundarySurfaces(Edges=crv_6)
data_5 = Data(boundary)

tstat_3 = TreeStatistics(Tree=data_5)  # -> Paths, Length, Count
lng_2 = ListLength(List=data_5)
cull_4 = CullPattern(List=tstat_3.Paths, CullPattern=flatten(lng_2))
lng_3 = ListLength(List=cull_4)

loop_start = LoopStart(N=expr("x-2", lng_3), T=switch.a)  # -> port, Counter, Data, Data_2
num = Number(loop_start.Counter)
data_6 = Data(data_5)
wires = BrepWireframe(Brep=data_6, Density=-1)
cull_5 = CullPattern(List=data_6, CullPattern=toggle_all_floors_preview)
join_2 = JoinCurves(Curves=wires, Preserve=False)  # -> simplify(Curves)
colourbytree = ColourByDataTrees(geo=cull_5)
colourbytree_2 = ColourByDataTrees(geo=join_2)

# ---- group: flip curve
crv_7 = Curve(join_2)
offset = Offset(Curve=crv_7, Distance=expr("-x", 1), Plane=PlaneXY(0, 0, 0), Corners=1)
pshift_2 = ShiftPaths(Data=offset, Offset=-1)
curvepoint = PointOnCurve(crv_7, parameter=0.5)
eval = EvaluateCurve(Curve=reparameterize(crv_7), Parameter="0.51")  # -> Point, Tangent, Angle
curvepoint_2 = PointOnCurve(pshift_2, parameter=0.5)
vec2pt = Vector2Pt(PointA=curvepoint, PointB=eval.Point, Unitize=False)  # -> Vector, Length
vec2pt_2 = Vector2Pt(PointA=curvepoint, PointB=curvepoint_2, Unitize=False)  # -> Vector, Length
xprod = CrossProduct(VectorA=vec2pt.Vector, VectorB=vec2pt_2.Vector, Unitize=False)  # -> Vector, Length
amp = Amplitude(Vector=xprod.Vector, Amplitude=1)
devec = DeconstructVector(Vector=xprod.Vector)  # -> XComponent, YComponent, ZComponent
smaller = SmallerThan(FirstNumber=devec.ZComponent, SecondNumber=0)  # -> SmallerThan, OrEqualTo
dispatch = Dispatch(List=crv_7, DispatchPattern=smaller.OrEqualTo)  # -> ListA, ListB
flip = FlipCurve(Curve=dispatch.ListB)  # -> Curve, Flag
geo_3 = Geometry([dispatch.ListA, flip.Curve])

# ---- group: flip curve / chk
vdis = VectorDisplay(Anchor=curvepoint, Vector=amp)

# ----
lng_4 = ListLength(List=data_6)
larger = LargerThan(FirstNumber=lng_4, SecondNumber=1)  # -> flatten(LargerThan), OrEqualTo
ma_2 = MassAddition(Input=larger.LargerThan)  # -> Result, PartialResults
cull_6 = CullPattern(List=geo_3, CullPattern=invert(ma_2.Result))
cull_7 = CullPattern(List=geo_3, CullPattern=ma_2.Result)
pshift_3 = ShiftPaths(Data=cull_7, Offset=-1)
clean_2 = CleanTree(RemoveNulls=True, RemoveInvalid=True, RemoveEmpty=True, Tree=pshift_3)
clean_3 = CleanTree(RemoveNulls=True, RemoveInvalid=True, RemoveEmpty=True, Tree=cull_6)
data_7 = Data([clean_3, clean_2])

# ---- group: floor plates
crv_8 = Curve(data_7)

# ---- group: bring a copy of entire floor set down one lvl
# to make e.g. 3.5m height projections, replace this bit
move_4 = Move(Geometry=crv_8, Motion=Z_3)  # -> Geometry, Transform
tstat_4 = TreeStatistics(Tree=move_4.Geometry)  # -> Paths, Length, Count
shift = ShiftList(List=tstat_4.Paths, Shift=-1, Wrap=True)
replace_2 = ReplacePaths(Data=move_4.Geometry, Search=tstat_4.Paths, Replace=shift)
tstat_5 = TreeStatistics(Tree=replace_2)  # -> Paths, Length, Count
cull_i_3 = CullIndex(List=reverse(tstat_5.Paths), Indices=0, Wrap=True)  # -> reverse(List)
branch_5 = TreeBranch(Tree=replace_2, Path=cull_i_3, MaintainPaths=True)

# ---- group: curves
data_8 = Data(crv_8)
data_9 = Data(branch_5)

# ----
num_2 = Number(num)
tstat_6 = TreeStatistics(Tree=data_8)  # -> Paths, Length, Count
tstat_7 = TreeStatistics(Tree=data_9)  # -> Paths, Length, Count
item_3 = ListItem(List=tstat_6.Paths, Index=num_2, Wrap=False)
item_4 = ListItem(List=tstat_7.Paths, Index=num_2, Wrap=False)
branch_6 = TreeBranch(Tree=data_8, Path=item_3, MaintainPaths=True)
branch_7 = TreeBranch(Tree=data_9, Path=item_4, MaintainPaths=True)
crv_9 = Curve(branch_6)
crv_10 = Curve(branch_7)
pcol = PolylineCollapse(Polyline=crv_10, Tolerance=clean_up_short_lines_mm)  # -> Polyline, Count
pcol_2 = PolylineCollapse(Polyline=crv_9, Tolerance=clean_up_short_lines_mm)  # -> Polyline, Count

# ---- group: floor
crv_11 = Curve(crv_9)

# ---- group: projection set
crv_12 = Curve(crv_10)

# ----
boundary_2 = BoundarySurfaces(Edges=crv_11)

# ---- group: main checker
srfsplit = SurfaceSplit(Surface=boundary_2, Curves=crv_12)

# ----
boundary_3 = BoundarySurfaces(Edges=crv_12)
srf = Surface(srfsplit)
graft = GraftTree(Tree=srf, IncludeEmptyLists=True, IncludeNullItems=True)
equals_2 = Equality(FirstNumber=loop_start.Counter, SecondNumber=expr("x-2", lng_3))  # -> Equality, Inequality

# ---- group: pointinsurface
srf_2 = Surface(srf)
wires_2 = BrepWireframe(Brep=srf_2, Density=-1)
graft_2 = GraftTree(Tree=srf_2, IncludeEmptyLists=True, IncludeNullItems=True)
join_3 = JoinCurves(Curves=wires_2, Preserve=False)
offset_l = OffsetLoose(Curve=join_3, Distance=expr("-x", "1"))
offset_l_2 = OffsetLoose(Curve=join_3, Distance="1")
pshift_4 = ShiftPaths(Data=offset_l_2, Offset=-1)
pshift_5 = ShiftPaths(Data=offset_l, Offset=-1)
curvepoint_3 = PointOnCurve(pshift_5, parameter=0.5)
curvepoint_4 = PointOnCurve(pshift_4, parameter=0.5)
srf_cp = SurfaceClosestPoint(Point=curvepoint_3, Surface=graft_2)  # -> Point, UVPoint, Distance
srf_cp_2 = SurfaceClosestPoint(Point=curvepoint_4, Surface=graft_2)  # -> Point, UVPoint, Distance

# ----
round = Round(Number=srf_cp_2.Distance)  # -> Nearest, Floor, Ceiling
round_2 = Round(Number=srf_cp.Distance)  # -> Nearest, Floor, Ceiling

# ---- group: pointinsurface (continued)
similar = Similarity(FirstNumber=round.Nearest, SecondNumber=0, Threshold=0.1)  # -> Similarity, AbsoluteDifference
similar_2 = Similarity(FirstNumber=round_2.Nearest, SecondNumber=0, Threshold=0.1)  # -> Similarity, AbsoluteDifference
cull_8 = CullPattern(List=srf_cp_2.Point, CullPattern=similar.Similarity)
cull_9 = CullPattern(List=srf_cp.Point, CullPattern=similar_2.Similarity)

# ---- group: pointinsurface / points inside their own surface
pt = Point([cull_8, cull_9])

# ---- group: 0 means its inside surface (distance to srf = 0)
srf_cp_3 = SurfaceClosestPoint(Point=pt, Surface=boundary_3)  # -> Point, UVPoint, Distance

# ----
bool = Boolean(invert(srf_cp_3.Distance))

# ---- group: put 0s back into empty branches
ma_3 = MassAddition(Input=bool)  # -> Result, PartialResults

# ----
cull_10 = CullPattern(List=graft, CullPattern=ma_3.Result)
geo_4 = Geometry(cull_10)
panel_3 = Panel(cull_10)
cull_11 = CullPattern(List=geo_4, CullPattern=equals_2.Inequality)
move_5 = Move(Geometry=cull_11, Motion=Vector(0, 0, 10))  # -> Geometry, Transform
loop_end = LoopEnd(
    port=loop_start.port,
    Exit=False,
    Data=loop_start.Data,
    Data_2=flatten(geo_4),
    pausedState=False,
    state="Last & Record",
    TimeOutVal=0)  # -> D0, simplify(D1)
preview_2 = CustomPreview(
    Geometry=move_5.Geometry,
    Shader={ambient=RGB(0, 0, 0), diffuse=RGB(255, 105, 180), emission=RGB(76, 32, 54), shine=0.5, specular=RGB(255, 255, 255), transparency=0})

data_10 = Data(data_6)
data_11 = Data(loop_end.D1)

# ---- group: clean intersecting floor areas
Z_5 = UnitZ(Factor=expr("x-200", panel_2))  # disabled
graft_3 = GraftTree(Tree=data_11, IncludeEmptyLists=True, IncludeNullItems=True)  # disabled
extr = Extrude(Base=graft_3, Direction=Z_5)  # disabled
bbx = BrepBrep(BrepA=brep_input_shape_to_calculate_with_holes, BrepB=extr)  # -> Curves, Points; disabled
line = Line(bbx.Curves)  # disabled
null = NullItem(Item=line)  # -> NullFlags, InvalidFlags, Description; disabled
cull_12 = CullPattern(List=bbx.Curves, CullPattern=null.NullFlags)  # disabled
divide = DivideCurve(Curve=cull_12, Count=10, Kinks=False)  # -> Points, Tangents, Parameters; disabled
graft_4 = GraftTree(Tree=cull_12, IncludeEmptyLists=True, IncludeNullItems=True)  # disabled
fline = FitLine(Points=divide.Points)  # disabled
end = EndPoints(Curve=fline)  # -> Start, End; disabled
pdecon = Deconstruct(Point=end.End)  # -> XComponent, YComponent, ZComponent; disabled
pdecon_2 = Deconstruct(Point=end.Start)  # -> XComponent, YComponent, ZComponent; disabled
similar_3 = Similarity(FirstNumber=pdecon_2.YComponent, SecondNumber=pdecon.YComponent, Threshold=0.1)  # -> Similarity, AbsoluteDifference; disabled
similar_4 = Similarity(FirstNumber=pdecon_2.XComponent, SecondNumber=pdecon.XComponent, Threshold=0.1)  # -> Similarity, AbsoluteDifference; disabled
and = GateAnd(A=similar_4.Similarity, B=similar_3.Similarity)  # disabled
cull_13 = CullPattern(List=graft_4, CullPattern=invert(and))  # disabled
pshift_6 = ShiftPaths(Data=cull_13, Offset=-2)  # disabled
lng_5 = ListLength(List=pshift_6)  # disabled
cull_14 = CullPattern(List=graft_3, CullPattern=invert(lng_5))  # disabled
pshift_7 = ShiftPaths(Data=cull_14, Offset=-1)  # disabled

# ----
mesh_2 = MeshBrep(
    Brep=data_10,
    Settings={GridMaxCount=0, GridMinCount=16, JaggedSeams=False, MaxEdgeLength=0, MinEdgeLength=0.0001, MinTolerance=0, Refine=True, RefineAngle=0, RelativeTolerance=0.65, SimplePlanes=True, Tolerance=0})

# ---- group: fancy bits / floor area + total area (grnd floor = 1)
area = Area(Geometry=mesh_2)  # -> Area, Centroid
division = Division(A=area.Area, B="1000000")
data_12 = Data(division)
tstat_8 = TreeStatistics(Tree=data_12)  # -> Paths, Length, Count
ma_4 = MassAddition(Input=flatten(data_12))  # -> Result, PartialResults
series_2 = Series(Start=1, Step=1, Count=tstat_8.Count)
replace_3 = ReplacePaths(Data=data_12, Search=tstat_8.Paths, Replace=series_2)
panel_4 = Panel(ma_4.Result)
panel_5 = Panel(replace_3)

# ----
total_floor_area = Panel(panel_4)

# ---- group: fancy bits
num_3 = Number(expr("x-1", preview_floor_no))
bool_2 = Boolean(press_to_hide_preview)
data_13 = Data(data_11)
wires_3 = BrepWireframe(Brep=data_13, Density=-1)
join_4 = JoinCurves(Curves=wires_3, Preserve=False)  # -> simplify(Curves)
group = Group(Objects=data_13)
box = Box(group)
debrep = DeconstructBrep(Brep=box)  # -> Faces, Edges, Vertices
Z_6 = UnitZ(Factor=expr("x-100", panel_2))
fcircle = CircleFit(Points=debrep.Vertices)  # -> Circle, Radius, Deviation
extr_2 = Extrude(Base=join_4, Direction=Z_6)
area_2 = Area(Geometry=fcircle.Circle)  # -> Area, Centroid
mesh_3 = MeshBrep(
    Brep=extr_2,
    Settings={GridMaxCount=0, GridMinCount=16, JaggedSeams=False, MaxEdgeLength=0, MinEdgeLength=0.0001, MinTolerance=0, Refine=True, RefineAngle=0, RelativeTolerance=0.65, SimplePlanes=True, Tolerance=0})
bool_3 = Boolean(ma_2.Result)
scale = Scale(Geometry=fcircle.Circle, Center=area_2.Centroid, Factor=scrub_to_move_text_away_from_breps)  # -> Geometry, Transform
cull_15 = CullPattern(List=mesh_3, CullPattern=invert(bool_3))
cull_16 = CullPattern(List=mesh_3, CullPattern=bool_3)
useable_area_s_per_floor = Panel(panel_5)
pshift_8 = ShiftPaths(Data=cull_16, Offset=-1)
multiplication = Multiplication(A=scrub_to_avoid_text_occlusion, B=text_size_scales_with_shape)
move_6 = Move(Geometry=data_10, Motion=Vector(0, 0, 10))  # -> Geometry, Transform
clean_4 = CleanTree(RemoveNulls=True, RemoveInvalid=True, RemoveEmpty=True, Tree=cull_15)
clean_5 = CleanTree(RemoveNulls=True, RemoveInvalid=True, RemoveEmpty=True, Tree=pshift_8)
ma_5 = MassAddition(Input=useable_area_s_per_floor)  # -> Result, PartialResults
data_14 = Data([clean_5, clean_4])
data_15 = Data(data_12)
tstat_9 = TreeStatistics(Tree=data_15)  # -> Paths, Length, Count
item_5 = ListItem(List=tstat_9.Paths, Index=num_3, Wrap=False)
branch_8 = TreeBranch(Tree=data_15, Path=item_5, MaintainPaths=True)  # -> graft(Branch)
bool_toggle_all_floors = Boolean(toggle_all_floors_preview)
bool_button_to_hide = Boolean(invert(bool_2))
Z_7 = UnitZ(Factor=expr("-x", "3000"))
and_2 = GateAnd(A=bool_toggle_all_floors, B=bool_button_to_hide)
bbox = BoundingBox(Content=clean, Plane=PlaneXY(0, 0, 0), UnionBox=True)  # -> Box, Box_2
number_slider = Slider(100000000, range=0..100000000)
mesh_4 = MeshBrep(
    Brep=bbox.Box,
    Settings={GridMaxCount=0, GridMinCount=16, JaggedSeams=False, MaxEdgeLength=0, MinEdgeLength=0.0001, MinTolerance=0, Refine=True, RefineAngle=0, RelativeTolerance=0.65, SimplePlanes=True, Tolerance=0})
volume = Volume(Geometry=mesh_4)  # -> Volume, Centroid
panel_6 = Panel("white floor area")
panel_7 = Panel("black floor area")
bool_4 = Boolean(bake_all_surfaces)

# ----
mesh_5 = MeshBrep(
    Brep=data_13,
    Settings={GridMaxCount=0, GridMinCount=16, JaggedSeams=False, MaxEdgeLength=0, MinEdgeLength=0.0001, MinTolerance=0, Refine=True, RefineAngle=0, RelativeTolerance=0.65, SimplePlanes=True, Tolerance=0})

# ---- group: fancy bits / floor area + total area (grnd floor = 1)
area_3 = Area(Geometry=mesh_5)  # -> Area, Centroid
division_2 = Division(A=area_3.Area, B="1000000")
data_16 = Data(division_2)
tstat_10 = TreeStatistics(Tree=data_16)  # -> Paths, Length, Count
ma_6 = MassAddition(Input=flatten(data_16))  # -> Result, PartialResults
series_3 = Series(Start=1, Step=1, Count=tstat_10.Count)
replace_4 = ReplacePaths(Data=data_16, Search=tstat_10.Paths, Replace=series_3)
panel_8 = Panel(ma_6.Result)
panel_9 = Panel(replace_4)

# ---- group: fancy bits / m3
division_3 = Division(A=volume.Volume, B=number_slider)

# ----
floor_area_s = Panel(ma_5.Result)
total_useable_floor_area = Panel(panel_8)

# ---- group: fancy bits (continued)
crv_cp = CurveClosestPoint(Point=area_3.Centroid, Curve=scale.Geometry)  # -> Point, Parameter, Distance
useable_area_s_per_floor_2 = Panel(panel_9)
ln = Line(StartPoint=area_3.Centroid, EndPoint=crv_cp.Point)
lng_6 = ListLength(List=ln)
random = Random(Range=multiplication, Number=lng_6, Seed=2)
ma_7 = MassAddition(Input=useable_area_s_per_floor_2)  # -> Result, PartialResults
ext = ExtendCurve(Curve=ln, Type=0, Start=0, End=random)
end_2 = EndPoints(Curve=ext)  # -> Start, End
len = Length(Curve=ln)  # -> flatten(Length)
ma_8 = MassAddition(Input=len)  # -> Result, PartialResults
division_4 = Division(A=division_3, B=ma_8.Result)
multiplication_2 = Multiplication(A=division_4, B=text_size_scales_with_shape)

# ----
useable_floor_area_s = Panel(ma_7.Result)

# ---- group: fancy bits
data_17 = Data(move_6.Geometry)
data_18 = Data(data_14)
data_19 = Data(ext)
pt_2 = Point(end_2.End)
num_4 = Number(division_2)

tstat_11 = TreeStatistics(Tree=data_18)  # -> Paths, Length, Count
tstat_12 = TreeStatistics(Tree=data_17)  # -> Paths, Length, Count
data_20 = Data(data_19)
data_21 = Data(pt_2)
data_22 = Data(num_4)
item_6 = ListItem(List=tstat_11.Paths, Index=num_3, Wrap=False)
item_7 = ListItem(List=tstat_12.Paths, Index=num_3, Wrap=False)
tstat_13 = TreeStatistics(Tree=data_20)  # -> Paths, Length, Count
tstat_14 = TreeStatistics(Tree=data_21)  # -> Paths, Length, Count
tstat_15 = TreeStatistics(Tree=data_22)  # -> Paths, Length, Count
branch_9 = TreeBranch(Tree=data_18, Path=item_6, MaintainPaths=True)
branch_10 = TreeBranch(Tree=data_17, Path=item_7, MaintainPaths=True)
item_8 = ListItem(List=tstat_13.Paths, Index=num_3, Wrap=False)
item_9 = ListItem(List=tstat_14.Paths, Index=num_3, Wrap=False)
item_10 = ListItem(List=tstat_15.Paths, Index=num_3, Wrap=False)
branch_11 = TreeBranch(Tree=data_20, Path=item_8, MaintainPaths=True)
branch_12 = TreeBranch(Tree=data_21, Path=item_9, MaintainPaths=True)
branch_13 = TreeBranch(Tree=data_22, Path=item_10, MaintainPaths=True)
cull_17 = CullPattern(List=branch_10, CullPattern=invert(bool_2))
cull_18 = CullPattern(List=branch_9, CullPattern=invert(bool_2))
move_7 = Move(Geometry=branch_12, Motion=Z_7)  # -> Geometry, Transform
smaller_2 = SmallerThan(FirstNumber=branch_13, SecondNumber="1")  # -> SmallerThan, OrEqualTo
cull_19 = CullPattern(List=cull_17, CullPattern=toggle_all_floors_preview)
cull_20 = CullPattern(List=cull_18, CullPattern=toggle_all_floors_preview)
cull_21 = CullPattern(List=branch_11, CullPattern=invert(smaller_2.OrEqualTo))
cull_22 = CullPattern(List=branch_12, CullPattern=invert(smaller_2.OrEqualTo))
cull_23 = CullPattern(List=branch_13, CullPattern=invert(smaller_2.OrEqualTo))
cull_24 = CullPattern(List=cull_21, CullPattern=and_2)
cull_25 = CullPattern(List=cull_22, CullPattern=and_2)
round_3 = Round(Number=cull_23)  # -> Nearest, Floor, Ceiling
concat = Concatenate(FragmentA=round_3.Nearest, FragmentB=" sqm")
preview_3 = CustomPreview(Geometry=cull_19, Shader=ColourSwatch(SwatchColor=RGB(0, 0, 0)))
preview_4 = CustomPreview(Geometry=cull_20, Shader=ColourSwatch(SwatchColor=RGB(255, 255, 255)))
preview_5 = CustomPreview(Geometry=cull_24, Shader=ColourSwatch(SwatchColor=RGB(219, 219, 219)))

# ---- group: fancy bits / white floor area (useable)
swatch = ColourSwatch(SwatchColor=RGB(255, 255, 255))
yz = YZPlane(Origin=cull_25)
tag = TextTag3D(Location=yz, Text=concat, Size=multiplication_2, Colour=swatch, Justification=8)

swatch_2 = ColourSwatch(SwatchColor=RGB(26, 26, 26))
tag_2 = TextTag(Location=move_7.Geometry, Text=branch_8, Colour=swatch_2)

# ---- group: fancy bits (continued)
bake_2 = ObjectBake(
    BakeToggle=bool_4,
    GeometryObjects=data_13,
    Layer="gh_useable floors",
    ObjectName="GH_Obj",
    ObjectColor=swatch,
    LayerColor=RGB(255, 255, 255))
bake_3 = ObjectBake(
    BakeToggle=bool_4,
    GeometryObjects=data_10,
    Layer="gh_floors",
    ObjectName="GH_Obj",
    ObjectColor=swatch_2,
    LayerColor=RGB(255, 255, 255))

# ==== cluster ColourByDataTrees: Separates Geometries in different data trees by Colour
geo = ClusterInput()
geo_2 = Geometry(geo)
data_tree_reference = Data(geo_2)
tstat = TreeStatistics(Tree=data_tree_reference)  # -> Paths, Length, Count
range = Range(Domain=Domain(0, 1), Steps=expr("x-1", tstat.Count))
gradient = Gradient(
    LowerLimit=0,
    UpperLimit=1,
    Parameter=range,
    stops=[0: RGB(234, 38, 0), 0.25: RGB(234, 126, 0), 0.5: RGB(254, 244, 84), 0.75: RGB(173, 203, 249), 1: RGB(75, 107, 169)])
graft = GraftTree(Tree=gradient, IncludeEmptyLists=True, IncludeNullItems=True)
tstat_2 = TreeStatistics(Tree=graft)  # -> Paths, Length, Count
replace = ReplacePaths(Data=graft, Search=tstat_2.Paths, Replace=tstat.Paths)
preview = CustomPreview(Geometry=geo_2, Shader=replace)
D = ClusterOutput(replace)
