# Grasshopper definition road maker 0.9.gh (Grasshopper 0.9.76)
# plug-ins: treesloth01, Anemone

# ----
# Control Panel
# Input
# inputs from flux have height, but outputs are flattened. reproject them back up after they're done turning into roads
road_lines_crv = Geometry([<curve referenced from the Rhino model> x580])
building_footprints_crv = Geometry([<curve referenced from the Rhino model> x3127])

# ----
# Run
run_roadmaker = Button()

max_road_width = Panel("10000")
checking_resolution = Panel("10")
division = Division(A=max_road_width, B=checking_resolution)

# ---- group: flatten to z=0
project = Project(Geometry=road_lines_crv, Plane=PlaneXY(0, 0, 0))  # -> Geometry, Transform
project_2 = Project(Geometry=building_footprints_crv, Plane=PlaneXY(0, 0, 0))  # -> Geometry, Transform

# ----
# if the first line should hit a building boundary, what width should we give that road?
distance_picker = Slider(1, range=0..10)
num = Number(distance_picker)

# ---- group: min distance of buildings from road
# Settings
number_slider = Slider(600, range=0..10000)

# ---- group: current loop (of total loops)
panel = Panel("of")

# ----
# Roadmaker v0.9
building_footprints_crv_2 = Geometry(project_2.Geometry)
road_lines_crv_2 = Geometry(project.Geometry)
clean = CleanTree(RemoveNulls=True, RemoveInvalid=True, RemoveEmpty=True, Tree=road_lines_crv_2)
renumber = RenumberPaths(Data=clean)
cls = Closed(Curve=renumber)  # -> Closed, Periodic
dispatch = Dispatch(List=renumber, DispatchPattern=cls.Closed)  # -> ListA, ListB
clean_2 = CleanTree(RemoveNulls=True, RemoveInvalid=True, RemoveEmpty=True, Tree=dispatch.ListB)
geo = Geometry(dispatch.ListA)
renumber_2 = RenumberPaths(Data=clean_2)
join = JoinCurves(Curves=renumber_2, Preserve=False)
preview = CustomPreview(Geometry=geo, Shader=ColourSwatch(SwatchColor=RGB(255, 0, 0)))
geo_2 = Geometry(simplify(join))
bool = Boolean(run_roadmaker)
panel_2 = Panel(division)
num_2 = Number(checking_resolution)
multiplication = Multiplication(A=num_2, B=panel_2)
max_width = Panel(multiplication)

# ---- group: min distance of buildings from road (continued)
offset_l = OffsetLoose(Curve=building_footprints_crv_2, Distance=number_slider)  # -> flatten(Curve)

# ---- group: Cull Duplicate Lines while maintaining data tree
geo_3 = Geometry(geo_2)
explode = Explode(Curve=geo_3, Recursive=True)  # -> Segments, Vertices
pshift = ShiftPaths(Data=explode.Segments, Offset=-1)
flatten = FlattenTree(Tree=pshift, Path="{0}")

# ---- group: Cull Duplicate Lines while maintaining data tree / get duplicate curves in index form
curvepoint = PointOnCurve(pshift, parameter=0.5)
flatten_2 = FlattenTree(Tree=curvepoint, Path="{0}")
cullpt = CullDuplicates(Points=flatten_2, Tolerance=0.1, CullMode=1)  # -> Points, Indices, Valence
lng = ListLength(List=cullpt.Points)
series = Series(Start=0, Step=1, Count=lng)
cull_i = CullIndex(List=series, Indices=cullpt.Indices, Wrap=True)

# ---- group: Cull Duplicate Lines while maintaining data tree / replace duplicate curves with null
replace = ReplaceItems(List=flatten, Indices=cull_i, Wrap=False)

# ---- group: Cull Duplicate Lines while maintaining data tree / maintain index
unflatten = UnflattenTree(Tree=replace, Guide=pshift)

# ---- group: Cull Duplicate Lines while maintaining data tree / clean it after it is in the right branch
clean_3 = CleanTree(RemoveNulls=True, RemoveInvalid=True, RemoveEmpty=True, Tree=unflatten)

# ---- group: Cull Duplicate Lines while maintaining data tree (continued)
join_2 = JoinCurves(Curves=clean_3, Preserve=False)
pshift_2 = ShiftPaths(Data=join_2, Offset=-1)
geo_4 = Geometry(pshift_2)

# ----
renumber_3 = RenumberPaths(Data=graft(geo_4))  # -> simplify(RenumberedData)
geo_5 = Geometry(renumber_3)
tstat = TreeStatistics(Tree=geo_5)  # -> Paths, Length, Count
loop_start = LoopStart(N=expr("x-1", tstat.Count), T=bool)  # -> port, Counter, Data, Data_2, Data_3
item = ListItem(List=tstat.Paths, Index=loop_start.Counter, Wrap=True)
branch = TreeBranch(Tree=geo_5, Path=item, MaintainPaths=True)  # -> simplify(Branch)

# ---- group: current loop (of total loops) (continued)
panel_3 = Panel(loop_start.Counter)
# Output
subtraction = Subtraction(A=tstat.Count, B=1)
panel_4 = Panel(subtraction)

# ----
lng_2 = ListLength(List=flatten(branch))
equals = Equality(FirstNumber=lng_2, SecondNumber=1)  # -> Equality, Inequality

# ---- group: for realtime preview purposes only
# only used for realtime preview purposes
loop_start_2 = LoopStart(Repeat=expr("x-1", tstat.Count), Trigger=bool)  # -> port, Counter, Data

# ----
geo_6 = Geometry(branch)
panel_5 = Panel(panel_2)
panel_6 = Panel(num_2)
geo_7 = Geometry(flatten(offset_l))
distance_to_check_for_buildings = Slider(31094, range=0..100000)
curvepoint_2 = PointOnCurve(geo_6, parameter=0.5)
crv_cp = CurveClosestPoint(Point=curvepoint_2, Curve=geo_7)  # -> Point, Parameter, Distance
lng_3 = ListLength(List=geo_7)
smaller = SmallerThan(FirstNumber=crv_cp.Distance, SecondNumber=distance_to_check_for_buildings)  # -> SmallerThan, OrEqualTo
series_2 = Series(Start=0, Step=1, Count=lng_3)
cull = CullPattern(List=series_2, CullPattern=smaller.SmallerThan)  # -> flatten(List)
sort = SortList(Keys=cull)  # -> Keys, ValuesA
dcon = DeleteConsecutive(Set=sort.Keys, Wrap=False)  # -> Set, Count
item_2 = ListItem(List=geo_7, Index=dcon.Set, Wrap=True)

geo_8 = Geometry(branch)
panel_7 = Panel(panel_2)
panel_8 = Panel(num_2)
series_3 = Series(Start=0, Step=panel_7, Count=expr("x+1", panel_8))
offset_l_2 = OffsetLoose(Curve=geo_8, Distance=expr("x/2", series_3))  # -> simplify(Curve)
graft = GraftTree(Tree=offset_l_2, IncludeEmptyLists=True, IncludeNullItems=True)  # -> simplify(Tree)
ccx = CurveCurve(CurveA=graft, CurveB=item_2)  # -> Points, ParamsA, ParamsB
pshift_3 = ShiftPaths(Data=ccx.Points, Offset=-1)
lng_4 = ListLength(List=pshift_3)
cull_2 = CullPattern(List=graft, CullPattern=invert(lng_4))
dispatch_2 = Dispatch(List=cull_2, DispatchPattern=equals.Equality)  # -> flatten(ListA), ListB
pshift_4 = ShiftPaths(Data=dispatch_2.ListB, Offset=-1)
geo_9 = Geometry([dispatch_2.ListA, pshift_4])
item_3 = ListItem(List=reverse(geo_9), Index=0, Wrap=True)

series_4 = Series(Start=0, Step=panel_5, Count=expr("x+1", panel_6))
pshift_5 = ShiftPaths(Data=offset_l_2, Offset=-1)
item_4 = ListItem(List=pshift_5, Index=distance_picker, Wrap=False)
preview_2 = CustomPreview(Geometry=item_2, Shader=ColourSwatch(SwatchColor=RGB(237, 237, 237)))

item_5 = ListItem(List=series_4, Index=distance_picker, Wrap=False)
min_distance = Panel(item_5)

# ---- group: Catcher - "if nothing comes out of the bottom, use this"
simplify = SimplifyTree(Tree=item_4, Front=False)
flatten_3 = FlattenTree(Tree=lng_4, Path="{0}")
lng_5 = ListLength(List=flatten_3)
bool_2 = Boolean(flatten_3)
ma = MassAddition(Input=bool_2)  # -> Result, PartialResults
equals_2 = Equality(FirstNumber=lng_5, SecondNumber=ma.Result)  # -> Equality, Inequality
cull_3 = CullPattern(List=simplify, CullPattern=equals_2.Equality)

# ----
offset_l_3 = OffsetLoose(Curve=geo_6, Distance=expr("-x/2", series_4))  # -> simplify(Curve)

graft_2 = GraftTree(Tree=offset_l_3, IncludeEmptyLists=True, IncludeNullItems=True)  # -> simplify(Tree)
pshift_6 = ShiftPaths(Data=offset_l_3, Offset=-1)
item_6 = ListItem(List=pshift_6, Index=num, Wrap=False)

ccx_2 = CurveCurve(CurveA=graft_2, CurveB=item_2)  # -> Points, ParamsA, ParamsB
pshift_7 = ShiftPaths(Data=ccx_2.Points, Offset=-1)
lng_6 = ListLength(List=pshift_7)
cull_4 = CullPattern(List=graft_2, CullPattern=invert(lng_6))
dispatch_3 = Dispatch(List=cull_4, DispatchPattern=equals.Equality)  # -> flatten(ListA), ListB
pshift_8 = ShiftPaths(Data=dispatch_3.ListB, Offset=-1)

# ---- group: Catcher - "if nothing comes out of the bottom, use this"
simplify_2 = SimplifyTree(Tree=item_6, Front=False)
flatten_4 = FlattenTree(Tree=lng_6, Path="{0}")
lng_7 = ListLength(List=flatten_4)
bool_3 = Boolean(flatten_4)
ma_2 = MassAddition(Input=bool_3)  # -> Result, PartialResults
equals_3 = Equality(FirstNumber=lng_7, SecondNumber=ma_2.Result)  # -> Equality, Inequality
cull_5 = CullPattern(List=simplify_2, CullPattern=equals_3.Equality)

# ----
geo_10 = Geometry([dispatch_3.ListA, pshift_8])

item_7 = ListItem(List=reverse(geo_10), Index=0, Wrap=True)

geo_11 = Geometry([item_7, item_3, cull_5, cull_3])
end = EndPoints(Curve=geo_11)  # -> Start, End
item_8 = ListItem(List=end.Start, Index=0, Wrap=True)  # -> Item, Item1
dist = Distance(PointA=item_8.Item, PointB=item_8.Item1)
loop_end = LoopEnd(
    port=loop_start.port,
    Exit=False,
    Data=geo_11,
    Data_2=dist,
    Data_3=branch,
    pausedState=False,
    state="Last & Record",
    TimeOutVal=0)  # -> D0, D1, D2
lng_8 = ListLength(List=flatten(loop_end.D0))
null = NullItem(Item=lng_8)  # -> NullFlags, InvalidFlags, Description
geo_road = Geometry(simplify(loop_end.D0))
geo_road_2 = Geometry(simplify(geo_road))

# ---- group: for realtime preview purposes only (continued)
loop_end_2 = LoopEnd(port=loop_start_2.port, Exit=False, Data=geo_11, pausedState=False, state="Constant & Record", TimeOutVal=0)

# ----
cull_6 = CullPattern(List=loop_end_2, CullPattern=null.NullFlags)
preview_3 = CustomPreview(Geometry=cull_6, Shader=ColourSwatch(SwatchColor=RGB(234, 255, 0)))

# ----
# road middle line (original)
panel_9 = Panel("road width (mm)")
num_3 = Number(simplify(loop_end.D1))
crv = Curve(simplify(loop_end.D2))

# ---- group: to check if all offset functions produce a pair of curves
# there should be nothing in here
clean_4 = CleanTree(RemoveNulls=True, RemoveInvalid=True, RemoveEmpty=False, Tree=geo_road_2)
lng_9 = ListLength(List=clean_4)
equals_4 = Equality(FirstNumber=lng_9, SecondNumber="2")  # -> Equality, Inequality
cull_7 = CullPattern(List=clean_4, CullPattern=equals_4.Equality)
cull_8 = CullPattern(List=clean_4, CullPattern=invert(equals_4.Equality))  # -> flatten(List)
panel_10 = Panel(cull_8)

# ----
clean_5 = CleanTree(RemoveNulls=True, RemoveInvalid=True, RemoveEmpty=True, Tree=cull_7)
geo_12 = Geometry(clean_5)

# ---- group: Close Polyline Pair
geo_13 = Geometry(geo_12)
item_9 = ListItem(List=geo_13, Index=0, Wrap=True)  # -> Item, Item1
end_2 = EndPoints(Curve=item_9.Item1)  # -> Start, End
end_3 = EndPoints(Curve=item_9.Item)  # -> Start, End
ln = Line(StartPoint=end_3.Start, EndPoint=end_2.Start)
ln_2 = Line(StartPoint=end_3.End, EndPoint=end_2.End)
join_3 = JoinCurves(Curves=[geo_13, ln_2, ln], Preserve=False)  # -> simplify(Curves)

# ----
crv_2 = Curve(join_3)
