# Grasshopper definition rendermonkey_v0.2.gh (Grasshopper 0.9.76)
# plug-ins: Python Interpreter, Anemone, Human

# ---- group: which views?
# RenderMonkey v0.2
toggle = BooleanToggle(False)
python = PythonScript(x=toggle)  # -> out, Views
# ---------- python: Python ----------
import Rhino
from scriptcontext import doc

doc = Rhino.RhinoDoc.ActiveDoc

Views = []

for view in doc.NamedViews:
    name = view.Name
    Views.append(name)

doc = ghdoc
# ---------- end python ----------
namedviews = Panel(python.Views)
list = ItemSelector(
    namedviews,
    {"BE02_L50 1.666  ss400": "BE02_L50 1.666 ss400", "btwn_ex0708_6 and ex03_filmwidth70_1500MM", "LQ_high view", "EYELEVEL01", "aerial view01", "EYELEVEL02", "aerial view02", "EYELEVEL03", "EYELEVEL04", "EYELEVEL05", "EYELEVEL06 0.666", "EYELEVEL07", "EYELEVEL08", "EYELEVEL09", "EYELEVEL10", "EYELEVEL11", "EYELEVEL12", "EYELEVEL13", "EYELEVEL14", "EYELEVEL15", "EYELEVEL15_v2", "EYELEVEL16"}, selected=["BE02_L50 1.666  ss400", "LQ_high view", "EYELEVEL01", "aerial view01", "EYELEVEL02", "aerial view02", "EYELEVEL03", "EYELEVEL04", "EYELEVEL05", "EYELEVEL06 0.666", "EYELEVEL07", "EYELEVEL08", "EYELEVEL09", "EYELEVEL10", "EYELEVEL11", "EYELEVEL12", "EYELEVEL13", "EYELEVEL14", "EYELEVEL15", "EYELEVEL15_v2", "EYELEVEL16"])
panel = Panel(list)

# ----
get_settings = Button()
get_vray = PythonScript(x=get_settings)  # -> out, ss, f_num, iso, wb, fov, cam, mat
# ---------- get_vray: Python ----------
import rhinoscriptsyntax as rs
import clr
import System
import Rhino.RhinoApp as rhinoapp

vray = rs.GetPlugInObject('V-Ray for Rhino')
if not vray:
    raise SystemExit('no Vray found or loaded.')

names = clr.Reference[System.Object]()
wb_r = clr.Reference[System.Object]()
wb_g = clr.Reference[System.Object]()
wb_b = clr.Reference[System.Object]()

# current materials in file
vray.GetSceneMaterialNames(names)

# shutter speed
shutter_spd = vray.GetPhysicalCameraShutterSpeed()
ss = shutter_spd

# white balance
vray.GetPhysicalCameraWhiteBalance(wb_r, wb_g, wb_b)
wb_r = str(wb_r.Value)
wb_g = str(wb_g.Value)
wb_b = str(wb_b.Value)
wb = ','.join([wb_r, wb_g, wb_b])

# others
f_num = vray.GetPhysicalCameraFNumber()
iso = vray.GetPhysicalCameraISO()
fov = vray.GetCameraFOVAngle()

print vray.GetPhysicalCameraType()
print vray.GetCameraType()
#vray.SaveVisopt(filepath)

# this is only for printing into command window
#rhinoapp.WriteLine(str(names))

print 'white balance: ', wb
print 'shutter speed: ', shutter_spd
print 'f-number: ', f_num
print 'iso: ', iso
print 'fov: ', fov
#print names
# ---------- end get_vray ----------
change_settings = Button()
set_vray = PythonScript(set_vray=change_settings)  # -> out
# ---------- set_vray: Python ----------
if set_vray:
    import rhinoscriptsyntax as rs
    import clr
    import System
    import Rhino.RhinoApp as rhinoapp
    
    vray = rs.GetPlugInObject('V-Ray for Rhino')
    if not vray:
        raise SystemExit('no Vray found or loaded.')
    
    names = clr.Reference[System.Object]()
    wb_r = clr.Reference[System.Object]()
    wb_g = clr.Reference[System.Object]()
    wb_b = clr.Reference[System.Object]()
    
    # current materials in file
    vray.GetSceneMaterialNames(names)
    
    # shutter speed
    if ss: shutter_spd = vray.SetPhysicalCameraShutterSpeed(ss)
    
    def remap(num, in_min, in_max, out_min, out_max):
        old_range = in_max - in_min
        new_range = out_max - out_min
        new_value = (((num - in_min) * new_range) / old_range) + out_min
        return new_value
    
    if wb:
        if 'Color' in str(type(wb)):
            wb_r = remap(wb.R, 0, 255, 0, 1)
            wb_g = remap(wb.G, 0, 255, 0, 1)
            wb_b = remap(wb.B, 0, 255, 0, 1)
            print wb_r
            vray.SetPhysicalCameraWhiteBalance(wb_r, wb_g, wb_b)
        else:
            raise SystemExit('input type must be Color')
    
    # others
    if f_num: f_num = vray.SetPhysicalCameraFNumber(f_num)
    if iso: iso = vray.SetPhysicalCameraISO(iso)
    if fov: fov = vray.SetCameraFOVOn(True, fov)
    else: vray.SetCameraFOVOn(False, fov)
    
    #vray.SaveVisopt(filepath)
    
    # this is only for printing into command window
    #rhinoapp.WriteLine(str(names))
    
    print 'white balance: ', wb
    print 'shutter speed: ', shutter_spd
    print 'f-number: ', f_num
    print 'iso: ', iso
    print 'fov: ', fov
# ---------- end set_vray ----------

# ---- group: simple multiple named views rendering / make subfolder
button = Button()  # disabled
folder_name_same_directory_as_gh_file = Panel("20170517_renderset_new")  # disabled
same_dir = PythonScript(y=button)  # -> out, a; disabled
# ---------- same_dir: Python ----------
import os.path as path

current_gh = ghenv.Component.OnPingDocument().FilePath
if current_gh:
    current_dir = path.dirname(current_gh)
else:
    raise SystemExit('please save grasshopper file first')

if filename:
    a = current_dir + '\\' + filename
else:
    a = current_dir + '\\'
# ---------- end same_dir ----------
concat = Concatenate(FragmentA=same_dir.a, FragmentB=folder_name_same_directory_as_gh_file)  # disabled

# ---- group: simple multiple named views rendering
toggle_2 = BooleanToggle(False)  # disabled
render_1 = PythonScript(Bool=toggle_2, file_dir=concat)  # -> out, views; inputs named_views_in: list; disabled
# ---------- render_1: Python ----------
if Bool:
    import scriptcontext as sc
    import Rhino
    import Grasshopper as gh
    import rhinoscriptsyntax as rs
    import os
    
    active_doc = Rhino.RhinoDoc.ActiveDoc
    sc.doc = active_doc
    vray = rs.GetPlugInObject('V-Ray for Rhino')
    
    try:
        os.stat(file_dir)
    except:
        os.mkdir(file_dir)
    
    rendered_views = []
    for index, named_view in enumerate(named_views_in):
        
        count = 0
        while count <= 3000:
            if gh.Kernel.GH_Document.IsEscapeKeyDown():
                print "ESC pressed on the GH canvas"
                raise SystemExit('stopped by pressing esc key')
            count += 100
            rs.Sleep(100)
        
        #print named_view
        
        rs.RestoreNamedView(named_view)
        if rs.IsViewMaximized(named_view) is not True:
            rs.MaximizeRestoreView(named_view)
        
        #make new filename
        filename = file_dir + '\\' + named_view
        
        if add_name:
            filename += add_name
        
        print 'rendering'
        vray.SetBatchRenderOn(True)
        rs.Command('_Render')
        rs.Command('_-SaveRenderWindowAs ' + '"%s"' %filename, echo=False)
        rendered_views.append(named_view)
        
        Rhino.RhinoApp.WriteLine('next render in 3 sec. repeatedly hit escape to cancel')
    
    vray.SetBatchRenderOn(False)
    views = rendered_views
    sc.doc = ghdoc
# ---------- end render_1 ----------

# ----
# this part can actually be simplified a lot in python
# construct lists to render and layers to toggle here
named_views = Panel(panel)
toggles_for_each_layer_in_relation_to_na = Panel("""0
1
1
1
1
1
1
1
1
1
0
1
1
1
1
1
1
1
1
1
1""")  # "toggles for each layer in relation to named views"

entwine = Entwine(Branch00=toggles_for_each_layer_in_relation_to_na, FlattenInputs=True)

# ---- group: prepare subfolder
folder_name_same_directory_as_gh_file_2 = Panel("20170518_renderset_new")
same_dir_2 = PythonScript(y=Button())  # -> out, a; same code as same_dir
concat_2 = Concatenate(FragmentA=same_dir_2.a, FragmentB=folder_name_same_directory_as_gh_file_2)

# ---- group: which layers to change
refresh_layer_list = Button()

layertable = LayerTable(Update=refresh_layer_list, AutoUpdate=False)  # -> Layers, FullLayerPaths, LayerColors, Linetypes, MaterialNames, Visible, PrintWidth, PrintColor
list_of_exceptions_case_sensitive = Panel("""ss
SS""")
python_2 = PythonScript(full_layer_path=layertable.FullLayerPaths, exceptions=list_of_exceptions_case_sensitive)  # -> out, graft(unique_top_layers); inputs full_layer_path: list, exceptions: list
# ---------- python_2: Python ----------
def flatten(l, ltypes=(list, tuple)):
    ltype = type(l)
    l = list(l)
    i = 0
    while i < len(l):
        while isinstance(l[i], ltypes):
            if not l[i]:
                l.pop(i)
                i -= 1
                break
            else:
                l[i:i + 1] = l[i]
        i += 1
    return ltype(l)


top_layers = []
sub_layers = []
for full_layer in full_layer_path:
    temp = full_layer.split(':')
    top_layers.append(temp[0])
    sub_layers.append(temp[1:])

check_names = list(set(top_layers))
sub_layers = flatten(sub_layers)

unique_top_layers = []
for name in check_names:
    
    if not name in exceptions:  # if name is not in exceptions to skip
        temp_bool = []
        
        if name in sub_layers:
            print 'oh no! %s exists in sublayers!' % name
            print '%s will be taken out of checklist' % name
            temp_bool.append(0)
        else:  # if the name is not in sub_layers (is unique), put it in the list
            temp_bool.append(1)
            unique_top_layers.append(name)
# ---------- end python_2 ----------
tmatch3 = TMatch3(data_2=layertable.Visible, data=layertable.Layers, R=python_2.unique_top_layers)  # -> L_3, L_4, L, L_2
len = TextLength(Text=tmatch3.L)
len_2 = TextLength(Text=python_2.unique_top_layers)
equals = Equality(FirstNumber=len_2, SecondNumber=len)  # -> Equality, Inequality
cull = CullPattern(List=tmatch3.L_3, CullPattern=equals.Equality)
cull_2 = CullPattern(List=tmatch3.L, CullPattern=equals.Equality)
bool = Boolean(flatten(cull))
data = Data(flatten(cull_2))

data_2 = Data(data)
list_2 = ItemSelector(
    data_2,
    {"nakagawa line", "20170428_mountain shapes", "20170501_section and plan", "20170417_mountain_measurements", "20170501_mountain", "CAD_section cut references", "20170508_mountain_v2", "gh_railings", "railing in front", "solid buildings"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}, selected="buildings opposite to hide")
tmatch = MatchText(Text=data, RegEx=graft(list_2), Case=True)
cull_3 = CullPattern(List=bool, CullPattern=tmatch)  # -> flatten(List)
layers = Panel(list_2)
current_visibility = Panel(cull_3)

# ----
all_layers_to_toggle = Panel(layers)

panel_2 = Panel(panel)
panel_3 = Panel(entwine)
all_layers_to_toggle_tensor_columns = Panel(all_layers_to_toggle)

run_batch_render = BooleanToggle(False)
false_check_layer_visibility_only_true_r = BooleanToggle(True)  # "False = Check Layer Visibility Only, True = Render"
toggle_to_rerun = BooleanToggle(True)
lng = ListLength(List=panel_2)
total_number_of_renders = Panel(lng)
cull_4 = CullPattern(List=panel_2, CullPattern=run_batch_render)
cull_5 = CullPattern(List=entwine, CullPattern=run_batch_render)
cull_6 = CullPattern(List=all_layers_to_toggle_tensor_columns, CullPattern=run_batch_render)

# ----
# change layers, render, repeat
panel_4 = Panel("lighting, vray settings")
loop_start = LoopStart(N=expr("x-1", total_number_of_renders), T=toggle_to_rerun, named_views=cull_4, layer_on_off=cull_5, layers=cull_6)  # -> port, Counter, Data, Data_2, Data_3, Data_4
panel_5 = Panel(loop_start.Counter)
item = ListItem(List=loop_start.Data_2, Index=loop_start.Counter, Wrap=True)  # -> flatten(Item)
item_2 = ListItem(List=loop_start.Data, Index=loop_start.Counter, Wrap=True)
render_name_suffix = Panel("_")
layers_2 = Panel(loop_start.Data_3)
named_view = Panel(item_2)
on_off = Panel(item)
bool_2 = Boolean(Toggle(True))
concat_3 = Concatenate(FragmentA=render_name_suffix, FragmentB=loop_start.Counter)
cull_7 = CullPattern(List=on_off, CullPattern=bool_2)
cull_8 = CullPattern(List=layers_2, CullPattern=bool_2)
bool_3 = Boolean(cull_7)
toggle_layers = PythonScript(layer_names=cull_8, toggles=bool_3)  # -> out, done; inputs layer_names: list, toggles: list
# ---------- toggle_layers: Python ----------
import rhinoscriptsyntax as rs
import scriptcontext as sc
import Rhino as rh


sc.doc = rh.RhinoDoc.ActiveDoc
if len(layer_names) == len(toggles):
    done = False
    for index, layer in enumerate(layer_names):
        rs.LayerVisible(layer, toggles[index])
        done = True
sc.doc = ghdoc
# ---------- end toggle_layers ----------
bool_4 = Boolean(invert(run_batch_render))

# ---- group: includes a 1 sec sleep
set_view = PythonScript(named_view=named_view, P=bool_2)  # -> out, bool_out
# ---------- set_view: Python ----------
import rhinoscriptsyntax as rs
import scriptcontext as sc
import Rhino as rh


if P:
    bool_out = False
    rs.Sleep(1000)
    sc.doc = rh.RhinoDoc.ActiveDoc
    rs.RestoreNamedView(named_view)
    if rs.IsViewMaximized(named_view) is not True:
        rs.MaximizeRestoreView(named_view)
    sc.doc = ghdoc
    bool_out = True
# ---------- end set_view ----------

# ----
and = GateAnd(A=set_view.bool_out, B=toggle_layers.done)
cull_9 = CullPattern(List=and, CullPattern=false_check_layer_visibility_only_true_r)

# ---- group: makes folder if not found
render_1_2 = PythonScript(named_view=named_view, save_dir=concat_2, add_name=concat_3, P=cull_9)  # -> out, bool_out
# ---------- render_1_2: Python ----------
import os
import rhinoscriptsyntax as rs
import Rhino as rh
import Grasshopper as gh

bool_out = None
if P == True:
    if named_view:
        rh.RhinoApp.WriteLine('beginning in 5 sec, press ESC to cancel')
        count = 0
        while count <= 5000:
            
            if gh.Kernel.GH_Document.IsEscapeKeyDown():
                print "ESC pressed on the GH canvas"
                raise SystemExit('stopped by pressing esc key')
            count += 10
            rs.Sleep(10)
        
        try:
            os.stat(save_dir)
        except:
            os.mkdir(save_dir)
        
        # make filename for current render
        filename = os.path.join(save_dir, named_view)
        if add_name:
            filename = filename + add_name
        print filename
        if named_view:
            vray = rs.GetPlugInObject('V-Ray for Rhino')
            rh.RhinoApp.WriteLine('rendering image %s' % named_view)
            vray.SetBatchRenderOn(True)
            rs.Command('_Render')
            rs.Command('_-SaveRenderWindowAs ' + '"%s"' %filename, echo=False)
            rh.RhinoApp.WriteLine('saved image as %s' % filename)
            vray.SetBatchRenderOn(False)
            bool_out = True
# ---------- end render_1_2 ----------

# ----
loop_end = LoopEnd(
    port=loop_start.port,
    Exit=bool_4,
    Data=loop_start.Data,
    Data_2=loop_start.Data_2,
    Data_3=loop_start.Data_3,
    Data_4=render_1_2.bool_out,
    pausedState=False,
    state="Constant output",
    TimeOutVal=0)  # -> D0, D1, D2, D3

# ==== cluster TMatch3
data = ClusterInput()
data_2 = ClusterInput()
R = ClusterInput()
data_3 = Data(data)
data_4 = Data(data_2)
tmatch = MatchText(Text=data_3, RegEx=R, Case=True)
not = GateNot(A=tmatch)
not_2 = GateNot(A=tmatch)
cull = CullPattern(List=data_3, CullPattern=tmatch)
cull_2 = CullPattern(List=data_3, CullPattern=not)
cull_3 = CullPattern(List=data_4, CullPattern=tmatch)
cull_4 = CullPattern(List=data_4, CullPattern=not_2)
L = ClusterOutput(cull)
L_2 = ClusterOutput(cull_2)
L_3 = ClusterOutput(cull_3)
L_4 = ClusterOutput(cull_4)
