# Grasshopper definition CLI_gh.gh (Grasshopper 0.9.76)
# plug-ins: Python Interpreter

_1_exe_dir_2_src_dir_3_new_folder = Slider(1, range=1..3)
cli_program_settings = Panel("-e")
program_exe_file = FilePath()
input_filepath = FilePath()
run_cli_program = PythonScript(
    exe_file=program_exe_file,
    file_in=input_filepath,
    run=Toggle(False),
    set_dir_out=_1_exe_dir_2_src_dir_3_new_folder,
    open_set_dir=Button())  # -> cmd_line_info, filedir_out
# ---------- run_cli_program: Python ----------
import subprocess, os

# wait for file
if not file_in:
    print 'please input file'
    raise SystemExit('please input file')

# 1. get command line program
program_in = str(exe_file)
program_dir = os.path.dirname(program_in)
program_exe = os.path.basename(program_in)
program_dir += '\\'

# 2. get input file
src_file = file_in
src_dir = os.path.dirname(src_file)
src_basename = os.path.basename(src_file)
src_filename, src_ext = os.path.basename(src_file).split('.')

# 3. make destination directory names and file names
dest_dir = src_dir + '\\gh_processed' + '\\'
dest_filename = src_filename + '_processed'
dest_ext = ''  # might be needed
dest_filename = dest_dir + dest_filename

# 4. make folder
if not os.path.exists(dest_dir):
    os.makedirs(dest_dir)

# 5. set input and output file names
input = src_file
output = dest_filename

if not os.path.splitext(output)[-1]:
    print 'output file may not have a file extension (e.g.".csv"). please add file extension after processing'

# 6. program settings
if settings_in:
    settings = ' '
    settings += settings_in
else:
    settings = ''



# 7. turn filenames into strings with quotes
input = input.replace('\\', '/')
input = '"%s"' % input
output = output.replace('\\', '/')
output = '"%s"' % output


# check length < 128
if len(input) > 128:
    print 'directories must be less than 128 characters long. process may fail.'
if len(output) > 128:
    print 'directories must be less than 128 characters long. process may fail.'


# 8. put them all together
cmd_line_args = ' '.join([program_exe, settings, input])

print cmd_line_args

if not settings_in:
    settings = ' -h'
    cmd_line_args = program_exe + settings

cmd = 'cmd.exe'
commands = 'pushd ' + program_dir + '\n'
commands += cmd_line_args + '\n'

print 'all command line arguments to be run: '
print commands


# 9. run process when toggle is True (please don't use a button for this part)
if run == True:
    
    process = subprocess.Popen(cmd,
                               shell = True,
                               stdin = subprocess.PIPE,
                               stdout = subprocess.PIPE,
                               stderr = subprocess.STDOUT
              )
    # whether or not i throw it into a var called verbose, it still runs
    verbose = process.communicate(commands)[0]
    if verbose.find('ERROR') > 0:
        raise SystemExit(verbose)
    print verbose
    exitcode = process.returncode
    if exitcode == 0:
        print 'successful!'
        #filepath_out = dest_filename
        filedir_out = dest_dir
        
    else:
        print exitcode
        raise SystemExit('error. check python script for details.')


# 10. set filedir_out
if set_dir_out:
    count = set_dir_out
    
    if count == 1:
        filedir_out = program_dir
    if count == 2:
        filedir_out = src_dir
    if count == 3:
        filedir_out = dest_dir
    if open_set_dir == True:
        os.startfile(filedir_out)
# ---------- end run_cli_program ----------
panel = Panel(run_cli_program.cmd_line_info)
panel_2 = Panel(run_cli_program.filedir_out)
